# Grasshopper definition envelope.ghx (Grasshopper 1.0.7)
# plug-ins: NGon

reload = Button()
py = PythonScript(reload=reload)
# ---------- py: Python ----------
from compas_rhino.utilities.misc import get_tolerance
from compas_rhino.utilities.misc import unload_modules

from compas_ghpython import unload_modules

unload_modules("compas")
unload_modules("compas_fab")
unload_modules("roslibpy")
unload_modules("fabrication_control")
unload_modules("assembly_information_model")
unload_modules("am_information_model")
unload_modules("ur_fabrication_control")
unload_modules("workshop_aaec_revamp")
unload_modules("add_on_am")
unload_modules("mobile_part_based_am")
# ---------- end py ----------
py_2 = PythonScript()  # -> HERE, DATA
# ---------- py_2: Python ----------
import os

HERE = os.path.dirname(ghdoc.Path)
DATA = os.path.abspath(os.path.join(HERE, "..", "data"))

#print(HERE)
print(DATA)
# ---------- end py_2 ----------

meshperface = CSharpScript()  # -> out, A; inputs M: Mesh
# ---------- meshperface: C# ----------
    List<Mesh> meshesOut = new List<Mesh>();
    foreach(MeshFace mf in M.Faces){
      Mesh meshToAdd = new Mesh();
      meshToAdd.Vertices.Add(M.Vertices[mf.A]);
      meshToAdd.Vertices.Add(M.Vertices[mf.B]);
      meshToAdd.Vertices.Add(M.Vertices[mf.C]);
      if(mf.IsQuad){
        meshToAdd.Vertices.Add(M.Vertices[mf.D]);
        meshToAdd.Faces.AddFace(new MeshFace(0, 1, 2, 3));
      } else {
        meshToAdd.Faces.AddFace(new MeshFace(0, 1, 2));
      }
      meshesOut.Add(meshToAdd);
    }
    A = meshesOut;
# ---------- end meshperface ----------

# ---- group: DESIGN / Shape Initialization
number_slider = Slider(0, range=0..360)
number_slider_2 = Slider(2, range=0..10)
number_slider_3 = Slider(0, range=0..10)
number_slider_4 = Slider(0.05, range=0..0.1)
number_slider_5 = Slider(0, range=0..10)
number_slider_6 = Slider(5, range=0..10)
toggle = BooleanToggle(False)

# ----
number_slider_7 = Slider(0.36, range=-5..5)  # disabled
number_slider_8 = Slider(4.29, range=0..5)  # disabled
number_slider_9 = Slider(0.87, range=0..5)  # disabled
number_slider_10 = Slider(2.07, range=0..5)  # disabled
number_slider_11 = Slider(3.49, range=0..5)  # disabled

# ---- group: DESIGN
create_wall = GhPythonScript(
    init=Button(),
    width=number_slider_6,
    height=number_slider_2,
    elsize=number_slider_4,
    x=number_slider_5,
    y=number_slider_3,
    rotation=number_slider,
    double_layer=toggle)  # -> wall
# ---------- create_wall: Python ----------
from add_on_am import Wall

import random
# create wall
wall = Wall(width, height, elsize, x, y, rotation)

print(wall.x_size, wall.z_size)
# ---------- end create_wall ----------

# ----
create_window = GhPythonScript(
    wall=create_wall,
    left=Slider(1, range=0..10),
    right=Slider(4, range=0..10),
    top=Slider(1.8, range=0..5),
    bottom=Slider(0.6, range=0..5))  # -> wall
# ---------- create_window: Python ----------
if left < right < wall.width and bottom < top < wall.height:
    wall.window((left, top), (right, bottom))
# ---------- end create_window ----------

num = Number([number_slider_8, number_slider_9, number_slider_10, number_slider_11])  # disabled
number_slider_12 = Slider(4, range=0..10)  # disabled
number_slider_13 = Slider(0.6, range=0..10)  # disabled

# ---- group: UNDULATION
number_slider_14 = Slider(0, range=0..6.2)
number_slider_15 = Slider(2, range=0..5)
number_slider_16 = Slider(0.1, range=0..10)
base_sine_crv = GhPythonScript(width=number_slider_6, a=number_slider_15, f=number_slider_16, ro=number_slider_14)  # -> curve
# ---------- base_sine_crv: Python ----------
import Rhino.Geometry as rg
import Rhino as rc
import math

points = []
iterator = [i*0.1 for i in range(int(width/0.1 +1.999))]
for x in iterator:
    points.append(rg.Point3d(x, -a*math.sin(2.0 * math.pi * f*x + ro), 0))

points = rc.Collections.Point3dList(points)
start_tangent = rg.Vector3d(iterator[0], a * 2.0 * math.pi * f * math.cos(2.0 * math.pi * f*iterator[0] + ro), 0)
end_tangent = rg.Vector3d(iterator[0], a * 2.0 * math.pi * f * math.cos(2.0 * math.pi * f*iterator[-1] + ro), 0)
curve = rg.Curve.CreateInterpolatedCurve(points, 3)
# ---------- end base_sine_crv ----------
undulate = GhPythonScript(
    wall=create_window,
    up_amp=number_slider_15,
    up_freq=number_slider_16,
    up_phase=number_slider_14,
    down_amp=number_slider_15,
    down_freq=number_slider_16,
    down_phase=number_slider_14)  # -> wall
# ---------- undulate: Python ----------
wall.undulate(up_amp, up_freq, up_phase ,down_amp, down_freq, down_phase)
# ---------- end undulate ----------

# ----
swatch = ColourSwatch(SwatchColor=RGB(255, 0, 0))  # disabled

# ---- group: VISUALIZATION
visualize = GhPythonScript(wall=undulate, show_mesh=Toggle(True), show_window=Toggle(True), delete_window=Toggle(True))  # -> rhmesh, vertices_window, vertices_support
# ---------- visualize: Python ----------
from compas_ghpython.artists import MeshArtist
import Rhino.Geometry as rg

rh_mesh = []
vertices_gate = []
vertices_all = []
disp_vectors = []

if delete_window:
    for vertex in wall.window_vertices:
        wall.mesh.delete_vertex(vertex)
        print("test")



if show_mesh:
    # Mesh Artist for visualization
    artist = MeshArtist(wall.mesh)
    rhmesh = artist.draw_mesh()


if show_window:
    k = []
    for vertex in wall.mesh.vertices():
        gp = wall.mesh.vertex_attribute(vertex, name='window')
        if gp: k.append(vertex)
    
    print k
    if len(k): vertices_window = artist.draw_vertices(vertices=k)

for vertex in wall.mesh.vertices():
    if wall.mesh.vertex_attribute(vertex, name='z') < 0.025:
        k.append(vertex)
if len(k): vertices_support = artist.draw_vertices(vertices=k)
# ---------- end visualize ----------
swatch_2 = ColourSwatch(SwatchColor=RGB(54, 45, 35))

# ----
galapagos = Galapagos(fitness=subtraction, gene=[number_slider_9, number_slider_8, number_slider_10, number_slider_11])
pt = Point(visualize.vertices_window)
mcol = MeshColours(Mesh=visualize.rhmesh, Colours=swatch_2)
number_slider_17 = Slider(0, range=0..10)  # disabled
area = Area(Geometry=mcol)  # -> Area, Centroid; disabled
number_slider_18 = Slider(3, range=0..10)  # disabled
number_slider_19 = Slider(4, range=0..10)  # disabled
number_slider_20 = Slider(2, range=0..10)  # disabled
number_slider_21 = Slider(3, range=0..10)
swatch_3 = ColourSwatch(SwatchColor=RGB(238, 0, 255))  # disabled
swatch_4 = ColourSwatch(SwatchColor=RGB(0, 255, 255))  # disabled
swatch_5 = ColourSwatch(SwatchColor=RGB(0, 208, 255))  # disabled
swatch_6 = ColourSwatch(SwatchColor=RGB(89, 0, 255))  # disabled
list = ValueList({"ur10e_map.json"}, selected="ur10e_map.json")
py_3 = PythonScript()  # -> DATA
# ---------- py_3: Python ----------
import os

#package_path = os.path.dirname(mobile_fabrication_control.__file__)
#DATA = os.path.abspath(os.path.join(package_path,"../../data"))

package_path = ghdoc.Path
# package_path = os.path.dirname(ur_fabrication_control.__file__)
#DATA = os.path.abspath(os.path.join(package_path,"../../data"))

# .stl files not stored in am_hackathon repo. but in mobile_fabrication_control
DATA = os.path.abspath(os.path.join(package_path,"../../../mobile_part_based_am/data/reachabilitymaps"))

print(package_path)
print(DATA)
# ---------- end py_3 ----------
file = GhPythonScript(DATA=py_3, file=list)  # -> filepath
# ---------- file: Python ----------
__author__ = "Gido"
__version__ = "2023.04.18"

import os
import rhinoscriptsyntax as rs

filepath = os.path.join(DATA, file)
# ---------- end file ----------

# ----
# Reachabilitymap to JSON
toggle_2 = BooleanToggle(True)
from_json = GhPythonScript(filepath=file, load=toggle_2)  # -> out, reachabilitymap, r
# ---------- from_json: Python ----------
__author__ = "Gido"
__version__ = "2023.04.18"

import rhinoscriptsyntax as rs
from add_on_am import ReachabilityMap

if load:
    reachabilitymap = ReachabilityMap.from_json(filepath)
    r = reachabilitymap.calc_radius()
# ---------- end from_json ----------
visualize_map = GhPythonScript(reachabilitymap=from_json.reachabilitymap)  # -> out, reachabilitymap, sphere_points, resolution, reachability_index; disabled
# ---------- visualize_map: Python ----------
__author__ = "Gido"
__version__ = "2023.04.17"

import rhinoscriptsyntax as rs

from compas.geometry import Frame
from compas_ghpython.utilities import draw_frame


sphere_points = []
reachability_index = []
for data in reachabilitymap.spheres_data():
    sphere_points.append(draw_frame(Frame(data[0], [1,0,0], [0,1,0])))
    reachability_index.append(data[1])
#sphere_points = draw_frames(sphere_frames)
resolution = reachabilitymap.resolution

print(max(reachability_index))
# ---------- end visualize_map ----------
sph = Sphere(Base=visualize_map.sphere_points, Radius=expr("x/10", visualize_map.resolution))  # disabled
gradient = Gradient(
    LowerLimit=0,
    UpperLimit=100,
    Parameter=visualize_map.reachability_index,
    stops=[0: RGB(234, 38, 0), 0.25: RGB(234, 126, 0), 0.5: RGB(254, 244, 84), 0.75: RGB(173, 203, 249), 1: RGB(75, 107, 169)])  # disabled
preview = CustomPreview(Geometry=sph, Material=gradient)  # disabled

envelope = GhPythonScript(
    wall=visualize.rhmesh,
    r_out=from_json.r,
    h_out=Slider(2, range=0..3),
    r_in=Slider(0.3, range=0..1),
    h_in=Slider(0.2, range=0..1),
    z_offset=Slider(0.2, range=0..1))  # -> envelope, wall; inputs wall: Mesh
# ---------- envelope: Python ----------
import Rhino.Geometry as rg
import Rhino as rc

#class Envelope:
#    def __init__(self, r_out, h_out, r_in, h_in, z_offset):
#        self.reach = self.create_sphere_cylinder(r_out, h_out)
#        self.deadzone = self.create_sphere_cylinder(r_in, h_in)
#        self.deadzone.Translate(0, 0, z_offset)
#        self.envelope = rg.Mesh()
#        self.envelope.Append([self.reach, self.deadzone])
#        self.envelope.Translate(1, 0, 0)
#    
#    def create_sphere_cylinder(self, r, h):
#        sphere = rg.Sphere(rg.Point3d(0, 0, 0,), r)
#        sph_cyl = rg.Mesh.CreateFromSphere(sphere, 16, 32)
#        
#        to_delete = []
#        sph_cyl.FaceNormals.ComputeFaceNormals()
#        for i, normal in enumerate(sph_cyl.FaceNormals):
#            if normal.Z > 0:
#                to_delete.append(i)
#        top_sphere = sph_cyl.Faces.ExtractFaces(to_delete)
#        top_sphere.Translate(0, 0, h)
#        
#        cylinder = rg.Cylinder(rg.Circle(rg.Point3d(0, 0, 0), r), h)
#        cylinder = rg.Mesh.CreateFromCylinder(cylinder, 10, 16, False, False)
#        
#        sph_cyl.Append([cylinder, top_sphere])
#        return sph_cyl
#
#e = Envelope(r_out, h_out, r_in, h_in, z_offset)
#meshes = []
#meshes.append(wall)
#meshes.append(e.envelope)
#intersections = rg.Intersect.Intersection.MeshMesh(meshes, 1.0e-10, False, False, None, None, None)
#
#reach = e.reach
#deadzone = e.deadzone
#envelope = e.envelope


class Envelope:
    def __init__(self, wall, r_out, h_out, r_in, h_in, z_offset):
        self.mesh = wall
        self.r_out = r_out
        self.r_in = r_in
        self.h_out = h_out
        self.h_in = h_in
        self.z_offset = z_offset
        self.x = 0
        self.y = 0
        self.z = 0
        
    def get_intersection(self, x=0, y=0, z=0, p=None):
        if p != None:
            self.x = p.X
            self.y = p.Y
            self.z = p.Z
        inside = []
        for i, vertex in enumerate(self.mesh.Vertices):
            condition1 = [vertex.Z > self.h_out+self.z, vertex.Z < self.z]
            condition2 = {
            "cylinder": (vertex.X-self.x)**2 + (vertex.Y-self.y)**2 < self.r_out**2,
            "upper circle": (vertex.X-self.x)**2 + (vertex.Y-self.y)**2 + (vertex.Z-self.h_out-self.z)**2 < self.r_out**2,
            "lower circle": (vertex.X-self.x)**2 + (vertex.Y-self.y)**2 + (vertex.Z-self.z)**2 < self.r_out**2
            }
            outside_condition = ((not (condition1[0] or condition1[1])) and condition2["cylinder"]) or (condition1[0] and condition2["upper circle"]) or (condition1[1] and condition2["lower circle"])
            
            condition1 = [vertex.Z-self.z_offset > self.h_in+self.z, vertex.Z-self.z_offset < self.z]
            condition2 = {
            "cylinder": (vertex.X-self.x)**2 + (vertex.Y-self.y)**2 > self.r_in**2,
            "upper circle": (vertex.X-self.x)**2 + (vertex.Y-self.y)**2 + (vertex.Z-(self.h_in+self.z_offset)-self.z)**2 > self.r_in**2,
            "lower circle": (vertex.X-self.x)**2 + (vertex.Y-self.y)**2 + (vertex.Z-self.z_offset-self.z)**2 > self.r_in**2
            }
            # inside_condition = ((not (condition1[0] or condition1[1])) and condition2["cylinder"]) or (condition1[0] and condition2["upper circle"]) or (condition1[1] and condition2["lower circle"])
            if not (condition1[0] or condition1[1]):
                inside_condition = condition2["cylinder"]
            elif condition1[0]:
                inside_condition = condition2["upper circle"]
            elif condition1[1]:
                inside_condition = condition2["lower circle"]
            else:
                inside_condition = False
            
            if inside_condition and outside_condition:
                inside += wall.Vertices.GetVertexFaces(i)
        return self.mesh.DuplicateMesh().Faces.ExtractFaces(inside)
        
    def create_mesh(self):
        reach = self.create_sphere_cylinder(self.r_out, self.h_out)
        deadzone = self.create_sphere_cylinder(self.r_in, self.h_in)
        deadzone.Translate(0, 0, self.z_offset)
        e = rg.Mesh()
        e.Append([reach, deadzone])
        e.Translate(self.x, self.y, self.z)
        return e
    
    def create_sphere_cylinder(self, r, h):
        sphere = rg.Sphere(rg.Point3d(0, 0, 0,), r)
        sph_cyl = rg.Mesh.CreateFromSphere(sphere, 16, 32)
        
        to_delete = []
        sph_cyl.FaceNormals.ComputeFaceNormals()
        for i, normal in enumerate(sph_cyl.FaceNormals):
            if normal.Z > 0:
                to_delete.append(i)
        top_sphere = sph_cyl.Faces.ExtractFaces(to_delete)
        top_sphere.Translate(0, 0, h)
        
        cylinder = rg.Cylinder(rg.Circle(rg.Point3d(0, 0, 0), r), h)
        cylinder = rg.Mesh.CreateFromCylinder(cylinder, 10, 16, False, False)
        
        sph_cyl.Append([cylinder, top_sphere])
        return sph_cyl
        
envelope = Envelope(wall, r_out, h_out, r_in, h_in, z_offset)
in_mesh = envelope.get_intersection(1.1, r_in, 0)
# ---------- end envelope ----------
seperation = GhPythonScript(crv=base_sine_crv, z=Slider(0, range=0..10), envelope=envelope.envelope, wall=create_wall, switch_sides=Toggle(True))  # -> whole_mesh, meshes, meshes_envelope, points; inputs crv: Curve
# ---------- seperation: Python ----------
import Rhino.Geometry as rg
import math


whole_mesh = rg.Mesh()
meshes = []
meshes_envelope = rg.Mesh()
dist = math.sqrt((envelope.r_out)**2 - (z+envelope.h_out-wall.height)**2 - envelope.r_in**2)
crv.Translate(0, 0, z)
# divide the wall with points that are equally spaced, the first point must not be at zero but at distance dist from 0
temp = crv.Split(crv.ClosestPoint(crv.DivideEquidistant(dist)[1])[1])[1]
points_t = temp.DivideEquidistant(dist*2)
points = points_t
if crv.PointAtEnd.DistanceTo(points_t[-1]) > dist:
    points = [point for point in points_t]
    points.append(crv.PointAtEnd)

for i, point in enumerate(points):
    normal = crv.TangentAt(crv.ClosestPoint(point)[1])
    if switch_sides:
        curvature = crv.CurvatureAt(crv.ClosestPoint(point)[1]).Y
        crv_sign = curvature/abs(curvature)
    else:
        crv_sign = 1.0
    normal.Rotate(crv_sign*math.pi/2, rg.Vector3d(0, 0, 1.0))
    normal.Unitize()
    
    point += (envelope.r_in*normal)
    points[i] = point
    mesh = envelope.get_intersection(p=point)
    if mesh != None:
        meshes.append(envelope.get_intersection(p=point))
        whole_mesh.Append(envelope.get_intersection(p=point))
    meshes_envelope.Append(envelope.create_mesh())

overlap = whole_mesh.Faces.ExtractDuplicateFaces()


# checking each face that appears twice for its second closest point and then removing it from the mesh that is associated with that point
# the points are the robots positions
for i, face in enumerate(overlap.Faces):
    center = overlap.Faces.GetFaceCenter(i)
    distance = []
    for point in points:
        distance.append(center.DistanceTo(point))
    for d in sorted(set(distance))[1:]:
        i_mesh_to_delete_from = distance.index(d)
        duplicate_face = meshes[i_mesh_to_delete_from].ClosestMeshPoint(center,0.05)
        if duplicate_face:
            i_face_to_delete = duplicate_face.FaceIndex
            meshes[i_mesh_to_delete_from].Faces.DeleteFaces([i_face_to_delete])

#
#points = []
#whole_mesh = rg.Mesh()
#meshes_envelope = rg.Mesh()
#dist = math.sqrt((envelope.r_out)**2 - (z+envelope.h_out-wall.height)**2 - envelope.r_in**2)
#crv.Translate(0, 0, z)
#k = crv.LengthParameter(dist)[1]
#t = k
#while t < crv.LengthParameter(crv.GetLength())[1]+k:
#    normal = crv.TangentAt(t)
#    if switch_sides:
#        curvature = crv.CurvatureAt(t).Y
#        crv_sign = curvature/abs(curvature)
#    else:
#        crv_sign = 1.0
#    normal.Rotate(crv_sign*math.pi/2, rg.Vector3d(0, 0, 1.0))
#    normal.Unitize()
#    point = crv.PointAt(t)
#    
#    point += (envelope.r_in*normal)
#    points.append(point)
#    mesh = envelope.get_intersection(p=point)
#    if mesh != None:
#        whole_mesh.Append(envelope.get_intersection(p=point))
#    meshes_envelope.Append(envelope.create_mesh())
#    t_old = t
#    t += 2*k


#top_edges = []
#for mesh in meshes:
#    edges = mesh.GetNakedEdges()[0].BreakAtAngles(math.pi/2)
#    for i, edge in enumerate(edges):
#        edge = edge.ToPolylineCurve()
#        if edge.PointAtStart.Z == wall.height and edge.PointAtEnd.Z == wall.height:
#            top_edges.append(edge)
#
#for edge in enumerate(top_edges[1:]):
#    split =
# ---------- end seperation ----------
mesh = Mesh(seperation.whole_mesh)
mesh_2 = Mesh(seperation.meshes_envelope)
pt_2 = Point(seperation.points)

python = GhPythonScript(
    width=number_slider_6,
    a=number_slider_15,
    f=number_slider_16,
    ro=number_slider_14,
    crv=base_sine_crv,
    x=num,
    y=number_slider_7,
    z=number_slider_13,
    duplications=number_slider_12,
    envelope=envelope.envelope,
    wall=envelope.wall)  # -> print_meshes, points; inputs x: list, duplications: Int32; disabled
# ---------- python: Python ----------
import Rhino.Geometry as rg
import math

print_meshes = rg.Mesh()
points = []
for i in range(duplications):
    y_temp = a*math.sin(2.0 * math.pi * f*x[i] + ro) - y
    points.append(rg.Point3d(x[i], -y_temp, z))
    print_meshes.Append(envelope.get_intersection(x[i], y_temp, z))
print_meshes.Faces.ExtractDuplicateFaces()
# ---------- end python ----------
pt_3 = Point(python.points)  # disabled
mcol_2 = MeshColours(Mesh=python.print_meshes, Colours=swatch)  # disabled
mesh_3 = Mesh(envelope.wall)  # disabled
area_2 = Area(Geometry=mcol_2)  # -> Area, Centroid; disabled
area_3 = Area(Geometry=mesh_3)  # -> Area, Centroid; disabled
subtraction = Subtraction(A=area_3.Area, B=area_2.Area)  # disabled
mesh_4 = Mesh(seperation.meshes)
mjoin = MeshJoin(Meshes=mesh_4)  # disabled
area_4 = Area(Geometry=mjoin)  # -> Area, Centroid; disabled
subtraction_2 = Subtraction(A=area.Area, B=area_4.Area)  # disabled
item = ListItem(List=mesh_4, Index=number_slider_17, Wrap=True)  # disabled
item_2 = ListItem(List=mesh_4, Index=number_slider_18, Wrap=True)  # disabled
item_3 = ListItem(List=mesh_4, Index=number_slider_20, Wrap=True)  # disabled
item_4 = ListItem(List=mesh_4, Index=number_slider_19, Wrap=True)  # disabled
item_5 = ListItem(List=mesh_4, Index=number_slider_21, Wrap=True)
panel = Panel(subtraction_2)  # disabled
mcol_3 = MeshColours(Mesh=item, Colours=swatch_3)  # disabled
mcol_4 = MeshColours(Mesh=item_4, Colours=swatch_4)  # disabled
mcol_5 = MeshColours(Mesh=item_2, Colours=swatch_5)  # disabled
mcol_6 = MeshColours(Mesh=item_3, Colours=swatch_6)  # disabled
mcol_7 = MeshColours(Mesh=item_5, Colours=ColourSwatch(SwatchColor=RGB(255, 0, 0)))
item_6 = ListItem(List=pt_2, Index=number_slider_21, Wrap=True)

# ----
# Path planner
path_type = ValueList({"Lowest Axis Path": 1, "Lowest Axis Path Combined": 2, "Lowest Axis Path Priority": 3, "Lowest Axis Path Adjusted": 4, "Centroid Path": 5, "Boundary Path": 6, "Corners Path": 7, "Random Path Adjusted": 8, "Lowest Neighbors Path": 9}, selected="Lowest Axis Path")
orientation = ValueList({"X-axis": "x", "Y-axis": "y", "Z-axis": "z"}, selected="Z-axis")
tool_path_planning = GhPythonScript(compute=Button(), path_type=path_type, orientation=orientation, mesh=mcol_7)  # -> planner, points, edges, n, planes
# ---------- tool_path_planning: Python ----------
import compas
from compas_rhino.geometry import RhinoMesh
from robotic_knitcrete.surface_path_planner import SurfacePathPlanner
from robotic_knitcrete.planner_mesh import PlannerMesh
from compas_ghpython.utilities import draw_network, draw_frame
import ghpythonlib.components as ghcomp
from compas.colors import Color
import time

rmesh = RhinoMesh.from_guid(mesh)
planner = SurfacePathPlanner()
planner.set_quad_mesh_from_rhinomesh(rmesh)
planner.set_network_nodes()
#planner.set_color_map([
#    Color.from_rgb255(128,255,255),
#    Color.from_rgb255(255,255,0),
#    Color.from_rgb255(255,0,0)])
#planner.set_thickness_map([
#    0.008,
#    0.010,
#    0.012])


if path_type == 1:
    [network, n] = planner.lowest_axis_path(orientation)

#planner.calculate_fabrication_parameters()

points, edges = draw_network(network)   
planes = []
tool_planes = []
cylinders = []
colors = []
for k in planner.network.path:
    frame = planner.network.node_attribute(key=k, name='frame')
    plane = draw_frame(frame)
    planes.append(plane)
    
print(planner.network.node_attributes(key=0))
# ---------- end tool_path_planning ----------
pt_4 = Point(tool_path_planning.points)
panel_2 = Panel(tool_path_planning.n)
path = Curve(tool_path_planning.edges)

unim = UnifyMesh(Mesh=mcol_3)  # -> Result, Count; disabled

# ----
# Mesh definition
swatch_7 = ColourSwatch(SwatchColor=RGB(255, 0, 0))  # disabled
swatch_8 = ColourSwatch(SwatchColor=RGB(255, 255, 0))  # disabled
swatch_9 = ColourSwatch(SwatchColor=RGB(0, 255, 255))  # disabled
mesh_curvature = MeshCurvature(
    Mesh=unim.Result,
    CurvatureType=5,
    Radius=3,
    Method=1,
    Interval=Domain(0, 0),
    _3Colors=[swatch_7, swatch_8, swatch_9],
    On=True)  # -> Mesh, CurvatureValues; disabled
bnd = Bounds(Numbers=mesh_curvature.CurvatureValues)  # disabled
remap = RemapNumbers(Value=mesh_curvature.CurvatureValues, Source=bnd, Target=Domain(0, 1))  # -> Mapped, Clipped; disabled
gradient_2 = Gradient(
    LowerLimit=0,
    UpperLimit=1,
    Parameter=remap.Mapped,
    stops=[0: RGB(128, 255, 255), 0.5: RGB(255, 255, 0), 1: RGB(255, 0, 0)])  # disabled
mcol_8 = MeshColours(Mesh=unim.Result, Colours=gradient_2)  # disabled

python_2 = GhPythonScript(points=pt_4, reachabilitymap=from_json.reachabilitymap, center=item_6, compute=Toggle(True))  # -> points, ri; inputs points: list of Point3d, center: Vector3d
# ---------- python_2: Python ----------
__author__ = "timda"
__version__ = "2023.04.20"

import rhinoscriptsyntax as rs

if compute:
    ri = reachabilitymap.apply_surface(points, center)
    
    print(ri)
# ---------- end python_2 ----------
explodemesh = ExplodeMesh(Mesh=mcol_7, Explode=Toggle(True))
gradient_3 = Gradient(
    LowerLimit=0,
    UpperLimit=100,
    Parameter=python_2.ri,
    stops=[0: RGB(234, 38, 0), 0.25: RGB(234, 126, 0), 0.5: RGB(254, 244, 84), 0.75: RGB(173, 203, 249), 1: RGB(75, 107, 169)])
subdmesh = SubDFromMesh(Mesh=explodemesh, Creases=1, Corners=1, Interpolate=False)
preview_2 = CustomPreview(Geometry=subdmesh, Shader=gradient_3)
