# Grasshopper definition wall_remeshing.ghx (Grasshopper 1.0.7)
# plug-ins: NGon, BullAnt

# ---- group: DESIGN / Shape Initialization
number_slider = Slider(0, range=0..360)
number_slider_2 = Slider(2, range=0..10)
number_slider_3 = Slider(0, range=0..10)
number_slider_4 = Slider(0.05, range=0..0.1)
number_slider_5 = Slider(0, range=0..10)
number_slider_6 = Slider(5, range=0..10)
toggle = BooleanToggle(False)

# ----
reload = Button()
py = PythonScript(reload=reload)
# ---------- py: Python ----------
from compas_rhino.utilities.misc import get_tolerance
from compas_rhino.utilities.misc import unload_modules

from compas_ghpython import unload_modules

unload_modules("compas")
unload_modules("compas_fab")
unload_modules("roslibpy")
unload_modules("fabrication_control")
unload_modules("assembly_information_model")
unload_modules("am_information_model")
unload_modules("ur_fabrication_control")
unload_modules("workshop_aaec_revamp")
unload_modules("add_on_am")
unload_modules("mobile_part_based_am")
# ---------- end py ----------
py_2 = PythonScript()  # -> HERE, DATA
# ---------- py_2: Python ----------
import os

HERE = os.path.dirname(ghdoc.Path)
DATA = os.path.abspath(os.path.join(HERE, "..", "data"))

#print(HERE)
print(DATA)
# ---------- end py_2 ----------

# ---- group: DESIGN
create_wall = GhPythonScript(
    init=Button(),
    width=number_slider_6,
    height=number_slider_2,
    elsize=number_slider_4,
    x=number_slider_5,
    y=number_slider_3,
    rotation=number_slider,
    double_layer=toggle)  # -> wall
# ---------- create_wall: Python ----------
from add_on_am import Wall

import random
# create wall
wall = Wall(width, height, elsize, x, y, rotation)

print(wall.x_size, wall.z_size)
# ---------- end create_wall ----------

# ---- group: UNDULATION
number_slider_7 = Slider(0, range=0..6.2)
number_slider_8 = Slider(0.5, range=0..5)
number_slider_9 = Slider(0.4, range=0..10)
base_sine_crv = GhPythonScript(width=number_slider_6, a=number_slider_8, f=number_slider_9, ro=number_slider_7)  # -> c_curve, curve
# ---------- base_sine_crv: Python ----------
import Rhino.Geometry as rg
from Rhino.Collections import Point3dList
from compas.geometry import NurbsCurve 
import math

points = []
iterator = [i*0.1 for i in range(int(width/0.1 +1.999))]
for x in iterator:
    points.append(rg.Point3d(x, -a*math.sin(2.0 * math.pi * f*x + ro), 0))

points = Point3dList(points)
start_tangent = rg.Vector3d(iterator[0], a * 2.0 * math.pi * f * math.cos(2.0 * math.pi * f*iterator[0] + ro), 0)
end_tangent = rg.Vector3d(iterator[0], a * 2.0 * math.pi * f * math.cos(2.0 * math.pi * f*iterator[-1] + ro), 0)
curve = rg.Curve.CreateInterpolatedCurve(points, 3)


c_curve = NurbsCurve().from_interpolation(points)
print(c_curve)
# ---------- end base_sine_crv ----------
undulate = GhPythonScript(
    wall=create_wall,
    up_amp=Slider(0.25, range=0..5),
    up_freq=Slider(0.8, range=0..10),
    up_phase=Slider(0, range=0..6.2),
    down_amp=number_slider_8,
    down_freq=number_slider_9,
    down_phase=number_slider_7)  # -> wall
# ---------- undulate: Python ----------
wall.undulate(up_amp, up_freq, up_phase ,down_amp, down_freq, down_phase)
# ---------- end undulate ----------

# ----
number_slider_10 = Slider(0, range=0..5307)  # disabled
number_slider_11 = Slider(100, range=0..1000)  # disabled
number_slider_12 = Slider(0.1, range=0..0.1)  # disabled
python = GhPythonScript(wall=undulate)  # -> rmesh, mesher; disabled
# ---------- python: Python ----------
__author__ = "timda"
__version__ = "2023.07.14"

import rhinoscriptsyntax as rs
from compas_ghpython.artists import MeshArtist
from add_on_am import Remesher


mesher = Remesher(wall.mesh, resolution=0.05)
mesher.shift_nodes()
mesher.add_nodes(wall.z_size, wall.x_size)
#mesher.add_nodes(mesher.z_size, mesher.x_size)
# mesher.shift_nodes()
mesh_artist = MeshArtist(mesher.mesh)
rmesh = mesh_artist.draw_mesh()
# ---------- end python ----------
toggle_2 = BooleanToggle(True)  # disabled
python_2 = GhPythonScript(wall=python.mesher, i=number_slider_10)  # -> p; disabled
# ---------- python_2: Python ----------
__author__ = "timda"
__version__ = "2023.07.14"

import rhinoscriptsyntax as rs
from Rhino.Geometry import Point3d
p = []
for i in wall.mesh.vertices():
    x, y, z = wall.mesh.vertex_coordinates(i)
    p.append(Point3d(x, y, z))
# ---------- end python_2 ----------
swatch = ColourSwatch(SwatchColor=RGB(255, 0, 0))  # disabled
mcol = MeshColours(Mesh=python.rmesh, Colours=swatch)  # disabled
python_3 = GhPythonScript(wall=undulate)  # -> rmesh, mesher; disabled
# ---------- python_3: Python ----------
__author__ = "timda"
__version__ = "2023.07.14"

import rhinoscriptsyntax as rs
from compas_ghpython.artists import MeshArtist
from add_on_am import NewMesher

print(wall.x_size)

mesher = NewMesher(wall.mesh, resolution=0.05)
mesher.shift_nodes()
new_mesh = mesher.regen()
mesh_artist = MeshArtist(new_mesh)
rmesh = mesh_artist.draw_mesh()
# ---------- end python_3 ----------
demesh = DeconstructMesh(Mesh=python_3.rmesh)  # -> Vertices, Faces, Colours, Normals; disabled

# ---- group: VISUALIZATION
visualize = GhPythonScript(wall=undulate, show_mesh=Toggle(True), show_window=Toggle(True), delete_window=Toggle(True))  # -> rhmesh, vertices_window, vertices_support
# ---------- visualize: Python ----------
from compas_ghpython.artists import MeshArtist
import Rhino.Geometry as rg

rh_mesh = []
vertices_gate = []
vertices_all = []
disp_vectors = []
#
#if delete_window:
#    for vertex in wall.window_vertices:
#        wall.mesh.delete_vertex(vertex)
#        print("test")



if show_mesh:
    # Mesh Artist for visualization
    artist = MeshArtist(wall.mesh)
    rhmesh = artist.draw_mesh()

#
#if show_window:
    k = []
#    for vertex in wall.mesh.vertices():
#        gp = wall.mesh.vertex_attribute(vertex, name='window')
#        if gp: k.append(vertex)
#    
#    print k
#    if len(k): vertices_window = artist.draw_vertices(vertices=k)

for vertex in wall.mesh.vertices():
    if wall.mesh.vertex_attribute(vertex, name='z') < 0.025:
        k.append(vertex)
if len(k): vertices_support = artist.draw_vertices(vertices=k)
# ---------- end visualize ----------
swatch_2 = ColourSwatch(SwatchColor=RGB(82, 82, 82))

# ----
pt = Point(visualize.vertices_window)
mcol_2 = MeshColours(Mesh=visualize.rhmesh, Colours=swatch_2)

ggmtb = GgMeshToBrep(Mesh=mcol_2, Collapse=Toggle(False), Triangulate=False, Tol=0.001)
python_4 = GhPythonScript(brep=ggmtb, wall=undulate)  # -> rmesh; inputs brep: Brep
# ---------- python_4: Python ----------
__author__ = "timda"
__version__ = "2023.07.14"

import rhinoscriptsyntax as rs
from compas_ghpython.artists import MeshArtist

mesh = wall.create_quad_mesh(brep)
mesh_art = MeshArtist(mesh)
rmesh = mesh_art.draw_mesh()
# ---------- end python_4 ----------
mesh = Mesh(python_4)
demesh_2 = DeconstructMesh(Mesh=mesh)  # -> Vertices, Faces, Colours, Normals
python_5 = GhPythonScript(mesh=visualize.rhmesh)  # -> mesh; inputs mesh: Mesh; disabled
# ---------- python_5: Python ----------
__author__ = "timda"
__version__ = "2023.07.14"

import Rhino
import rhinoscriptsyntax as rs
import scriptcontext

parameters = {
    'AdaptiveQuadCount': True, 
    'AdaptiveSize': 50.0, 
    'DetectHardEdges': True, 
    'GuideCurveInfluence': 0, 
    'PreserveMeshArrayEdgesMode': 0, 
    'SymmetryAxis': Rhino.Geometry.QuadRemeshSymmetryAxis.X | Rhino.Geometry.QuadRemeshSymmetryAxis.Y | Rhino.Geometry.QuadRemeshSymmetryAxis.Z, 
    'TargetQuadCount': 2000,
}

#parameters = {
#    "TargetEdgeLength": 0.1,
#    'PreserveMeshArrayEdgesMode': 0,
#    'TargetQuadCount': 2000,
#}

params = Rhino.Geometry.QuadRemeshParameters()
for param_name, value in sorted(parameters.items()):
    setattr(params, param_name, value)

mesh.QuadRemesh(params)

print(mesh)
# ---------- end python_5 ----------
remesh = Remesh(Mesh=visualize.rhmesh, FixEdges=toggle_2, EdgeLength=number_slider_12, Iterations=number_slider_11, Project=True)  # disabled
