# Grasshopper definition wall.ghx (Grasshopper 1.0.7)
# plug-ins: Karamba3D

reload = Button()
py = PythonScript(reload=reload)
# ---------- py: Python ----------
from compas_rhino.utilities.misc import get_tolerance
from compas_rhino.utilities.misc import unload_modules

from compas_ghpython import unload_modules

unload_modules("compas")
unload_modules("compas_fab")
unload_modules("roslibpy")
unload_modules("fabrication_control")
unload_modules("assembly_information_model")
unload_modules("am_information_model")
unload_modules("ur_fabrication_control")
unload_modules("workshop_aaec_revamp")
unload_modules("add_on_am")
# ---------- end py ----------
py_2 = PythonScript()  # -> HERE, DATA
# ---------- py_2: Python ----------
import os

HERE = os.path.dirname(ghdoc.Path)
DATA = os.path.abspath(os.path.join(HERE, "..", "data"))

#print(HERE)
print(DATA)
# ---------- end py_2 ----------

# ---- group: DESIGN / Shape Initialization
number_slider = Slider(0, range=0..360)
number_slider_2 = Slider(2, range=0..10)
number_slider_3 = Slider(0, range=0..10)
number_slider_4 = Slider(4, range=0..10)
number_slider_5 = Slider(0.05, range=0..0.1)
number_slider_6 = Slider(0, range=0..10)
toggle = BooleanToggle(False)

# ---- group: DESIGN
create_wall = GhPythonScript(
    init=Button(),
    width=number_slider_4,
    height=number_slider_2,
    elsize=number_slider_5,
    x=number_slider_6,
    y=number_slider_3,
    rotation=number_slider,
    double_layer=toggle)  # -> wall
# ---------- create_wall: Python ----------
from add_on_am import Wall

import random
# create wall
wall = Wall(width, height, elsize, x, y, rotation)

print(wall.x_size, wall.z_size)
# ---------- end create_wall ----------

# ----
number_slider_7 = Slider(1, range=0..10)
number_slider_8 = Slider(3, range=0..10)
number_slider_9 = Slider(100, range=0..100)  # disabled
python = GhPythonScript()  # -> out, a
# ---------- python: Python ----------
print(x(a))
# ---------- end python ----------
create_window = GhPythonScript(
    wall=create_wall,
    left=number_slider_7,
    right=number_slider_8,
    top=Slider(1.8, range=0..5),
    bottom=Slider(0.6, range=0..5))  # -> out, wall
# ---------- create_window: Python ----------
if left < right < wall.width and bottom < top < wall.height:
    wall.window((left, top), (right, bottom))
# ---------- end create_window ----------

# ---- group: UNDULATION
undulate = GhPythonScript(
    wall=create_window.wall,
    up_amp=Slider(0.019, range=0..0.1),
    up_freq=Slider(3, range=0..10),
    up_phase=Slider(0, range=0..6.2),
    down_amp=Slider(0.587, range=0..1),
    down_freq=Slider(0.5, range=0..10),
    down_phase=Slider(0, range=0..6.2))  # -> wall
# ---------- undulate: Python ----------
wall.undulate(up_amp, up_freq, up_phase ,down_amp, down_freq, down_phase)
# ---------- end undulate ----------

# ----
list = ValueList({"N1": 0, "N2": 1}, selected="N2")  # disabled
python_2 = GhPythonScript(select=list)  # -> norm_n, red, green, blue; inputs n1: list, n2: list; disabled
# ---------- python_2: Python ----------
if select:
    n = n1
elif not select:
    n = n2

max_n = max(n) # 1
min_n = min(n) # -1
# n=0
norm_n = []
red = []
green = [0 for _ in n]
blue = []
for force in n:
    if force >= 0:
        norm_force = 255*force/max_n
        red.append(255)
        blue.append(0)
    elif force < 0:
        norm_force = 255*force/min_n
        red.append(0)
        blue.append(255)
    norm_n.append(norm_force)
print(len(red), len(blue), len(green))
# ---------- end python_2 ----------

# ---- group: VISUALIZATION
visualize = GhPythonScript(wall=undulate, show_mesh=Toggle(True), show_window=Toggle(True), delete_window=Toggle(True))  # -> rhmesh, vertices_window, vertices_support
# ---------- visualize: Python ----------
from compas_ghpython.artists import MeshArtist
import Rhino.Geometry as rg

rh_mesh = []
vertices_gate = []
vertices_all = []
disp_vectors = []

if delete_window:
    for vertex in wall.window_vertices:
        wall.mesh.delete_vertex(vertex)
        print("test")



if show_mesh:
    # Mesh Artist for visualization
    artist = MeshArtist(wall.mesh)
    rhmesh = artist.draw_mesh()


if show_window:
    k = []
    for vertex in wall.mesh.vertices():
        gp = wall.mesh.vertex_attribute(vertex, name='window')
        if gp: k.append(vertex)
    
    print k
    if len(k): vertices_window = artist.draw_vertices(vertices=k)

for vertex in wall.mesh.vertices():
    if wall.mesh.vertex_attribute(vertex, name='z') < 0.025:
        k.append(vertex)
if len(k): vertices_support = artist.draw_vertices(vertices=k)
# ---------- end visualize ----------
swatch = ColourSwatch(SwatchColor=RGB(54, 45, 35))

# ----
# Forces
number_slider_10 = Slider(10, range=0..10)
cross_section = CrossSectionKaramba3D(
    FamilyNameOfCrossSection="DefaultCroSec",
    Height_cm=number_slider_10,
    ReinforcementAreas_cm2_m=[0, 0, 0, 0],
    ReinforcementConcreteCovers_cm=[3.5, 4.5, -4.5, -3.5],
    PrincipalReinforcementDirection_deg=0,
    mode="Shell RC Standard - Const.")
pt = Point(visualize.vertices_support)
loads = LoadsKaramba3D(Vector=Vector(0, 0, -1), LCase="0", mode="Gravity")
supp = SupportKaramba3D(PosInd=pt, menu=[buttons(on, on, on, off, off, off)])
meshtoshell = MeshToShellKaramba3D(Mesh=visualize.rhmesh, Identifier="Mesh", CrossSection=cross_section, LimitDistance_m=0.005)  # -> Element, Points, Info
assemble = AssembleModelKaramba3D(Elem=meshtoshell.Element, Support=supp, Load=loads, LimitDistance_m=0.005)  # -> Model, Info, Mass_kg, CenterOfGravity, LoadCaseNames
analyze = AnalyzeKaramba3D(Model=assemble.Model)  # -> CalculatedModel, MaximumDisplacement_cm, ResultingForceOfGravity_kN, ElasticEnergyChange_kNm
s_forces = ShellForcesKaramba3D(AnalyzedModel=analyze.CalculatedModel, mode="Local")  # -> AnalyzedModel, Nxx_kN_m, Nyy_kN_m, Nxy_kN_m, Mxx_kNm_m, Myy_kNm_m, Mxy_kNm_m, Vx_kN_m, Vy_kN_m

modelview = ModelViewKaramba3D(Model=analyze.CalculatedModel, ResultFactors=number_slider_9, ResultCase=-1)  # -> Model, DeformedMesh, DeformedAxes, DeformedModel; disabled
mesh = Mesh(modelview.DeformedMesh)  # disabled
shellview = ShellViewKaramba3D(Model=modelview.Model, IndexOfLayer=0)  # -> Model, MeshesOfRenderedShells, LegendColors, LegendTags; disabled
panel = Panel(shellview.LegendTags)  # disabled
disassemble = DisassembleModelKaramba3D(Model=s_forces.AnalyzedModel)  # -> Model, Point, Beam, Shell, Support, Load, Line, Mesh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; disabled
mesh_2 = Mesh(shellview.MeshesOfRenderedShells)  # disabled
number_slider_11 = Slider(255, range=0..1000)  # disabled
demesh = DeconstructMesh(Mesh=mesh_2)  # -> Vertices, Faces, Colours, Normals; disabled
panel_2 = Panel(shellview.LegendColors)  # disabled
rgb = ColourRGB(Alpha=number_slider_11, Red=python_2.red, Green=python_2.green, Blue=python_2.blue)  # disabled
demesh_2 = DeconstructMesh(Mesh=disassemble.Mesh)  # -> Vertices, graft(Faces), Colours, Normals; disabled
panel_3 = Panel(demesh.Colours)  # disabled
python_3 = GhPythonScript(colors=demesh.Colours)  # -> red, green, blue; inputs colors: list; disabled
# ---------- python_3: Python ----------
red = []
green = [0 for _ in colors]
blue = []
for color in colors:
    if color[0] == 255:
        red.append(0)
        blue.append(255)
    elif color[2] == 255:
        red.append(255)
        blue.append(0)
    else:
        print(error)
        red.append(255)
        blue.append(255)
# ---------- end python_3 ----------
number_slider_12 = Slider(255, range=0..1000)  # disabled
conmesh = ConstructMesh(Vertices=demesh_2.Vertices, Faces=demesh_2.Faces)  # disabled
rgb_2 = ColourRGB(Alpha=number_slider_12, Red=python_3.red, Green=python_3.green, Blue=python_3.blue)  # disabled
pt_2 = Point(visualize.vertices_window)
mcol = MeshColours(Mesh=conmesh, Colours=graft(rgb))  # disabled
mcol_2 = MeshColours(Mesh=visualize.rhmesh, Colours=swatch)
mcol_3 = MeshColours(Mesh=mesh_2, Colours=rgb_2)  # disabled
# red = x
# green = y
# blue = z
modelview_2 = ModelViewKaramba3D(Model=s_forces.AnalyzedModel, ResultFactors=1, ResultCase=-1)  # -> Model, DeformedMesh, DeformedAxes, DeformedModel

medges = MeshEdges(Mesh=visualize.rhmesh)  # -> NakedEdges, InteriorEdges, NonManifoldEdges
addition = Addition(A=number_slider_6, B=number_slider_4)
edges = GhPythonScript(
    edges=medges.NakedEdges,
    wall_left=number_slider_6,
    wall_right=addition,
    window_left=number_slider_7,
    window_right=number_slider_8)  # -> left, right, win_left, win_right; inputs edges: list of Curve
# ---------- edges: Python ----------
import Rhino.Geometry as rg
import ghpythonlib.components as ghcomp
import math

#ghcomp.JoinCurves(curves=[], preserve=False)
left = []
right = []
win_left = []
win_right = []
for edge in edges:
    if edge.PointAtStart.X == edge.PointAtEnd.X:
        if edge.PointAtStart.X == wall_left:
            left.append(edge)
        if edge.PointAtStart.X == wall_right:
            right.append(edge)
        if edge.PointAtStart.X == window_left:
            win_left.append(edge)
        if edge.PointAtStart.X == window_right:
            win_right.append(edge)


left = ghcomp.JoinCurves(curves=left, preserve=False)
right = ghcomp.JoinCurves(curves=right, preserve=False)
win_left = ghcomp.JoinCurves(curves=win_left, preserve=False)
win_right = ghcomp.JoinCurves(curves=win_right, preserve=False)
# ---------- end edges ----------
list_2 = ValueList({"1:10": 0.1, "1:5": 0.2}, selected="1:10")
# Curve Generation
div_len = GhPythonScript(scalefactor=list_2)  # -> max_layer_height, avg_layer_height, min_layer_height
# ---------- div_len: Python ----------
max_layer_height = 0.0065 / scalefactor
avg_layer_height = 0.0045 / scalefactor
min_layer_height = 0.0030 / scalefactor
print (avg_layer_height)
# ---------- end div_len ----------
print_path_generation = GhPythonScript(
    max_layer_height=div_len.max_layer_height,
    avg_layer_height=div_len.avg_layer_height,
    min_layer_height=div_len.min_layer_height,
    angle_constraint="25",
    wall=undulate,
    rhmesh=visualize.rhmesh,
    wall_left=edges.left,
    wall_right=edges.right,
    win_left=edges.win_left,
    win_right=edges.win_right,
    blend_layers="25")  # -> crvs, planes; inputs wall_left: Curve, wall_right: Curve, win_left: Curve, win_right: Curve, blend_layers: Int32
# ---------- print_path_generation: Python ----------
import Rhino.Geometry as rg
import ghpythonlib.components as ghcomp
import math


def tangents(region, dir, angle, start, end):
    if region == "bottom":
        start.Rotate(math.radians(dir*angle), rg.Vector3d.YAxis)
        end.Rotate(math.radians(dir*angle), rg.Vector3d.YAxis)
    return start, end


def generate_planes(wall_left, wall_right):
    tsl = wall_left.DivideByLength(avg_layer_height, True)
    tsr = wall_right.DivideByLength(avg_layer_height, True)
    ts = tsl if len(tsl)<=len(tsr) else tsr
    left = [wall_left.PerpendicularFrameAt(t)[1] for t in tsl[:len(ts)]]
    right = [wall_right.PerpendicularFrameAt(t)[1] for t in tsr[:len(ts)]]
    return left, right


def generate_crvs(wall_left, wall_right, region="bottom", l_to_r=True, angle=0):
    # curve left to right
    if l_to_r:
        dir = 1
    else:
        dir = -1
        
    base_tangent = rg.Vector3d(dir,0,0)
    
    # generate planes on each border in given distance
    planes_left, planes_right = generate_planes(wall_left, wall_right)
    
    # start and end tangents for straight curves
    tangent_start, tangent_end = tangents(region, dir, angle , base_tangent.Clone(), base_tangent.Clone())
    
    # interpolate between left and right planes
    crvs = []
    for i, plane_left in enumerate(planes_left):
        plane_right = planes_right[i]
        
        vertices = [plane_left.Origin, plane_right.Origin]
        
        c, c_len, c_domain = ghcomp.Interpolatet(vertices, tangent_start, tangent_end, knotstyle=0)
        crvs.append(c)

    return crvs


def split_borders(left, right, win_left, win_right):
    left_bottom, left_temp = left.Split(left.ClosestPoint(win_left.PointAtStart)[1])
    right_bottom, right_temp = right.Split(right.ClosestPoint(win_right.PointAtStart)[1])
    left_centre, left_top = left_temp.Split(left_temp.ClosestPoint(win_left.PointAtEnd)[1])
    right_centre, right_top = right_temp.Split(right_temp.ClosestPoint(win_right.PointAtEnd)[1])
    return [left_bottom, right_bottom], [left_centre, right_centre], [left_top, right_top]


bottom, centre, top = split_borders(wall_left, wall_right, win_left, win_right)

crvs_wall_bottom = generate_crvs(bottom[0], bottom[1], region="bottom", angle=0)
crvs_left = generate_crvs(centre[0], win_left, region="bottom", angle=0)
crvs_right = generate_crvs(win_right, centre[1], region="bottom", angle=0)
crvs_wall_top = generate_crvs(top[0], top[1], region="bottom", angle=0)


crvs = crvs_wall_bottom + crvs_left + crvs_right + crvs_wall_top
# ---------- end print_path_generation ----------

list_3 = ValueList({"nx", "ny", "nxy"}, selected="nx")
# Split Mesh
python_4 = GhPythonScript(wall=undulate, nx=s_forces.Nxx_kN_m, ny=s_forces.Nyy_kN_m, nxy=s_forces.Nxy_kN_m, force=list_3, show_forces=Toggle(True))  # -> faces_tension, faces_compression; inputs nx: list, ny: list, nxy: list
# ---------- python_4: Python ----------
from compas_ghpython.artists import MeshArtist
from compas.colors import Color
import Rhino.Geometry as rg
red = Color(1, 0, 0)
blue = Color(0, 0, 1)

force_dict = {
"nx": nx,
"ny": ny,
"nxy": nxy,
}
print(force, force_dict[force])
wall.zones(force_dict[force])
if show_forces:
    artist = MeshArtist(wall.mesh)
    tension = []
    compression = []
    for face in wall.mesh.faces():
        gp = wall.mesh.face_attribute(face, name="tension")
        if gp: tension.append(face)
        else: compression.append(face)
    if len(tension): faces_tension = artist.draw_faces(faces=tension, color=red, join_faces=True)
    if len(compression): faces_compression = artist.draw_faces(faces=compression, color=blue, join_faces=True)
# ---------- end python_4 ----------
mcol_4 = MeshColours(Mesh=python_4.faces_tension, Colours=ColourSwatch(SwatchColor=RGB(255, 0, 0)))
mcol_5 = MeshColours(Mesh=python_4.faces_compression, Colours=ColourSwatch(SwatchColor=RGB(0, 115, 255)))

Y = UnitY(Factor=1)
Y_2 = UnitY(Factor=1)
projecttomesh = CSharpScript(Curve=print_path_generation.crvs, Mesh=mcol_5, Direction=Y_2)  # -> crvs_compression; inputs Curve: Curve, Mesh: Mesh, Direction: Vector3d
# ---------- projecttomesh: C# usings ----------
using System.IO;
using System.Linq;
using System.Data;
using System.Drawing;
using System.Reflection;
using System.Windows.Forms;
using System.Xml;
using System.Xml.Linq;
using System.Runtime.InteropServices;

using Rhino.DocObjects;
using Rhino.Collections;
using GH_IO;
using GH_IO.Serialization;
# ---------- projecttomesh: C# ----------
    if (null != Curve && null != Mesh && Direction.IsValid)
    {
      var tol = RhinoDoc.ActiveDoc.ModelAbsoluteTolerance;
      A = Curve.ProjectToMesh(Curve, Mesh, Direction, tol);
    }
# ---------- end projecttomesh ----------
# Projection
projecttomesh_2 = CSharpScript(Curve=print_path_generation.crvs, Mesh=mcol_4, Direction=Y)  # -> crvs_tension; inputs Curve: Curve, Mesh: Mesh, Direction: Vector3d; same code as projecttomesh
